# Grasshopper definition Dijkstra_A-Star.gh (Grasshopper 1.0.8)
# plug-ins: Human, Jaybird

curve = Curve([<curve referenced from the Rhino model> x5000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])
explode = Explode(Curve=curve, Recursive=True)  # -> flatten(Segments), Vertices
make_graph = MakeGraph(Lines=explode.Segments, TwoWay=Toggle(True))
point = Point(<point referenced from the Rhino model>)
point_2 = Point(<point referenced from the Rhino model>)
analyze_graph = AnalyzeGraph(Graph=make_graph)  # -> Nodes, Edges, DeadEnds, Crossroads, Orphans, Islands
closest_point = ClosestPoint(Point=point_2, Cloud=analyze_graph.Nodes)  # -> ClosestPoint, CPIndex, Distance
closest_point_2 = ClosestPoint(Point=point, Cloud=analyze_graph.Nodes)  # -> ClosestPoint, CPIndex, Distance
a = A(Graph=make_graph, StartNode=closest_point_2.CPIndex, EndNode=closest_point.CPIndex, ShowVisitedEdges=Toggle(False))  # -> Path, VisitedEdges
dijkstra = Dijkstra(Graph=make_graph, StartNode=closest_point_2.CPIndex, EndNode=closest_point.CPIndex, ShowVisitedEdges=Toggle(False))  # -> Path, VisitedEdges
panel = Panel(analyze_graph.Orphans)
panel_2 = Panel(analyze_graph.Islands)
panel_3 = Panel(analyze_graph.Crossroads)
panel_4 = Panel(analyze_graph.DeadEnds)
custom_preview_lineweights = CustomPreviewLineweights(Geometry=a.Path, Shader=ColourSwatch(SwatchColor=RGB(0, 47, 255)), Thickness=Slider(4, range=0..10), Absolute=False)
custom_preview_lineweights_2 = CustomPreviewLineweights(
    Geometry=a.VisitedEdges,
    Shader=ColourSwatch(SwatchColor=RGB(130, 153, 255)),
    Thickness=Slider(2, range=0..10),
    Absolute=False)
custom_preview_lineweights_3 = CustomPreviewLineweights(
    Geometry=dijkstra.VisitedEdges,
    Shader=ColourSwatch(SwatchColor=RGB(247, 141, 141)),
    Thickness=Slider(2, range=0..10),
    Absolute=False)
custom_preview_lineweights_4 = CustomPreviewLineweights(
    Geometry=dijkstra.Path,
    Shader=ColourSwatch(SwatchColor=RGB(255, 0, 0)),
    Thickness=Slider(4, range=0..10),
    Absolute=False)
custom_preview_lineweights_5 = CustomPreviewLineweights(
    Geometry=analyze_graph.Edges,
    Shader=ColourSwatch(SwatchColor=RGB(255, 255, 255)),
    Thickness=Slider(1, range=0..10),
    Absolute=False)
